# Grasshopper definition Thallus Phone Case v2.gh (Grasshopper 1.0.8)
# plug-ins: Kangaroo2 Components

crv = Curve(<curve referenced from the Rhino model>)
number_slider = Slider(34, range=0..100)
move = Move(Geometry=crv, Motion=Vector(0, 0, 10))  # -> Geometry, Transform
divide = DivideCurve(Curve=move.Geometry, Count=Slider(400, range=0..10000), Kinks=False)  # -> Points, Tangents, Parameters
geometry = Geometry(<curve referenced from the Rhino model>)
shift = ShiftList(List=divide.Points, Shift=1, Wrap=True)
boundary_surfaces = BoundarySurfaces(Edges=geometry)
ln = Line(StartPoint=divide.Points, EndPoint=shift)
mesh = MeshBrep(
    Brep=boundary_surfaces,
    Settings={GridMaxCount=0, GridMinCount=16, JaggedSeams=False, MaxEdgeLength=0, MinEdgeLength=0.0001, MinTolerance=0, Refine=True, RefineAngle=0, RelativeTolerance=0.65, SimplePlanes=True, Tolerance=0})
shift_2 = ShiftList(List=ln, Shift=1, Wrap=True)
collider = Collider(Objects=ln, Radii=Slider(1.441, range=0..10), Strength="20")
angle = Angle(LineA=ln, LineB=shift_2, RestAngle="0", Strength="60")
length_line = LengthLine(Line=ln, Length=Slider(1, range=0..10), Strength=10)
onmesh = OnMesh(Points=divide.Points, Mesh=mesh, Strength="1000")
bouncysolver = BouncySolver(
    GoalObjects=flatten([collider, length_line, onmesh, angle]),
    Reset=Button(),
    Threshold=1e-15,
    Tolerance=0.0001,
    Damping=Slider(1, range=0..1),
    Iterations=10,
    On=Toggle(False))  # -> I, V, O
nurbs = NurbsCurve(Vertices=bouncysolver.V, Degree=3, Periodic=invert(False))  # -> Curve, Length, Domain
boundary_surfaces_2 = BoundarySurfaces(Edges=nurbs.Curve)
